% Simulink data dictionary worldDD.sldd

C = Simulink.Bus()
  A: double[4 4]
  b: double[4 1]
  c: double[4 1]
  x0: double[4 1]
  off: double[4 1]
  on: double[4 1]
  get: double[4 1]
  diff: double[4 1]

controller_in = Simulink.Bus()
  u: double
  x1: double
  x2: double
  x3: double
  x4: double

controller_out = Simulink.Bus()
  h1: int8
  h2: int8
  h3: int8
  h4: int8